# Grasshopper definition slice.ghx (Grasshopper 1.0.7)

python = GhPythonScript()  # -> out, rhino_mesh
# ---------- python: Python ----------
from compas import get_bunny
from compas.datastructures import Mesh

from compas_ghpython import draw_mesh


bunny = Mesh.from_ply(get_bunny())

print(bunny)

rhino_mesh = draw_mesh(*bunny.to_vertices_and_faces())
# ---------- end python ----------
mesh = Mesh(python.rhino_mesh)
scale = Scale(Geometry=mesh, Center=Point(0, 0, 0), Factor=Slider(1000, range=0..1000))  # -> Geometry, Transform
X = UnitX(Factor=1)
rot3d = Rotate3D(Geometry=scale.Geometry, Angle=1.570796327, Center=Point(0, 0, 0), Axis=X)  # -> Geometry, Transform
contour = Contour(Shape=rot3d.Geometry, Point=Point(0, 0, 0), Direction=Vector(0, 0, 1), Distance=Slider(5, range=0..10))
divdist = DivideDistance(Curve=contour, Distance=Slider(5, range=0..10))  # -> Points, Tangents, Parameters
trim = TrimTree(Tree=divdist.Points, Depth=1)  # -> simplify(Tree)
pl = ConstructPlane(Origin=trim, XAxis=Vector(1, 0, 0), YAxis=Vector(0, 1, 0))
path = FilePath("C:\Users\tetov\src\compas_internal_workshop\out\frames.json")
pflip = FlipPlane(Plane=pl, ReverseX=False, ReverseY=False, SwapAxes=True)
python_2 = GhPythonScript(rhino_planes=flatten(pflip), path=path, save=Button())  # -> out; inputs rhino_planes: list of Plane
# ---------- python_2: Python ----------
from compas_rhino.conversions import plane_to_compas_frame
from compas.data import json_dump

print(len(rhino_planes))
print(path)
    
frames = []
if save:
    for plane in rhino_planes:
        frames.append(plane_to_compas_frame(plane))
        
    json_dump(frames, path, pretty=True)
# ---------- end python_2 ----------
